# Dynamo graph visualizeDiff.dyn (Dynamo 2.12.1.8246)

file_path = Filename("..\..\..\..\05-09-2022_12-49.json")
file_path_2 = Filename("..\..\..\..\05-09-2022_12-50.json")
loadSnapshots = DynamoVersionTrackingUtilities.BucketLoader.LoadSnapshots(snapshotPathInit=file_path, snapshotPathUpdated=file_path_2)
